vi "Function.gvi"   [LabVIEW Communications System Design Suite 2.0.1]
panel controls:
  "Boolean": bool
diagram:
  New Data Value Reference(data value=TRUE) -> (data value reference=w1)
  call "source.gvi"(stop=w1) -> (queue out=w2)
  call "processor.gvi"(stop=w1, queue in=w2) -> (queue out=w3)
  call "processor.gvi"(stop=w1, queue in=w3) -> (queue out=w4)
  call "processor.gvi"(stop=w1, queue in=w4)
  while {
    w5 = $Boolean
    in-place {
      Read Poser(ro0=w1)
      Write Poser(wi0=w5)
    }
    stop if w5
  }
