vi "Function_2.gvi"   [LabVIEW Communications System Design Suite 2.0.1]
panel controls:
  "stop": bool
  "up 1": bool
  "up 2": bool
panel indicators:
  "cnt 1": i32
  "cnt 2": i32
diagram:
  while {
    call "cnt.gvi"(up=$"up 1") -> (cnt=w1)
    $"cnt 1" <- w1
    call "cnt.gvi"(up=$"up 2") -> (cnt=w2)
    $"cnt 2" <- w2
    stop if $stop
  }
