vi "Channel.gvi"   [LabVIEW Communications System Design Suite 2.0.1]
inputs:
  "sample_in queue": Queue<c128>
  "sample_out queue": Queue<c128>
  "channel coeff": DataValueReference<c128[]>
  "timeout": i32 = -1
  "error in": error
  "stop ch": DataValueReference<bool>
  "Noise amp": DataValueReference<f64>
outputs:
  "error out": error
diagram:
  while {
    Dequeue Element(error in=$"error in", queue=$"sample_in queue", timeout in ms=$timeout) -> (element=w1, error out=w2)
    in-place {
      Read Poser(ro0=$"channel coeff") -> (ri0=w3, ri1=w4)
      Write Poser(wi0=w3)
    }
    call "FIRConv.gvi"(x_in=w1, h=w3) -> (x out=w5)
    in-place {
      Read Poser(ro0=$"Noise amp") -> (ri0=w6, ri1=w7)
      Write Poser(wi0=w6)
    }
    call "Noise.gvi"(amp=w6, error in=w4) -> (noise=w8)
    Add(w5, w8) -> w9
    Enqueue Element(element=w9, error in=w2, queue=$"sample_out queue", timeout in ms=$timeout) -> (error out=w10)
    in-place {
      Read Poser(ro0=$"stop ch") -> (ri0=w11, ri1=w12)
      Write Poser(wi0=w11)
    }
    stop if w11
  }
  $"error out" <- w10
