vi "GenRadomData.gvi"   [LabVIEW Communications System Design Suite 2.0.1]
inputs:
  "data in": Queue<u8>
  "Max size": i32 = 10
  "error in": error
outputs:
  "error out": error
  "data": u8[]
diagram:
  while (iteration -> i1) {
    Random Number() -> (number (0 to 1)=w2)
    Multiply(w2, 255) -> w3
    To Unsigned Byte Integer(number=w3) -> w4
    Enqueue Element(element=w4, error in=$"error in", queue=$"data in", timeout in ms=-1) -> (error out=w5)
    Is Less Or Equal(x=$"Max size", y=i1) -> w6
    append w4 to w1
    stop if w6
  }
  $data <- w1
  $"error out" <- w5
