vi "Noise.gvi"   [LabVIEW Communications System Design Suite 2.0.1]
inputs:
  "amp": f64 = 1
  "error in": error
outputs:
  "noise": c128
  "error out": error
uses:
  NI::Analysis::Generation::Uniform White Noise Waveform.gvi
diagram:
  call "Uniform White Noise Waveform.gvi"(amplitude=1, error in=$"error in", sample rate=1, samples=1) -> (error out=w1, uniform white noise=w2)
  Property Node(instance in=w2) -> ("Y"=w3)
  Array Index(array=w3) -> (out0[_]=w4)
  Multiply(w4, $amp) -> w5
  call "Uniform White Noise Waveform.gvi"(amplitude=1, error in=$"error in", sample rate=1, samples=1) -> (error out=w6, uniform white noise=w7)
  Property Node(instance in=w7) -> ("Y"=w8)
  Array Index(array=w8) -> (out0[_]=w9)
  Multiply(w9, $amp) -> w10
  Real And Imaginary To Complex(x=w5, y=w10) -> w11
  $noise <- w11
  Merge Errors(w1, w6) -> (error out=w12)
  $"error out" <- w12
