vi "ReadAll.gvi"   [LabVIEW Communications System Design Suite 2.0.1]
inputs:
  "tx": "TX.queue.gtype"
  "rx": "RX.queue.gtype"
  "N_data": i32
  "N_qam": i32
  "N_samples": i32
  "N_CE": i32
  "N_preamble": i32
  "error in": error
outputs:
  "data in": u8[]
  "qam out": c128[]
  "data out": u8[]
  "qam in": c128[]
  "samples in": c128[]
  "ce out": c128[]
  "pre out": c128[]
  "error out": error
types:
  "RX.queue.gtype" = cluster{"data": Queue<u8>, "samples": Queue<c128>, "qam": Queue<c128>, "sync": Queue<c128>, "pre": Queue<c128>, "CE": Queue<c128>, "qam debug": Queue<c128>, "pre debug": Queue<c128>, "CE debug": Queue<c128>, "eq": Queue<c128>}
  "TX.queue.gtype" = cluster{"data": Queue<u8>, "qam": Queue<c128>, "samples": Queue<c128>, "qam debug": Queue<c128>, "samples debug": Queue<c128>, "data debug": Queue<u8>}
diagram:
  Property Node(instance in=$tx) -> ("data debug"=w1, "qam debug"=w2, "samples debug"=w3)
  call "ReadQueue.gvi"(queue uint8=w1, N_elements=$N_data, type="uint8", timeout=-1, error in=$"error in") -> (out uint8=w4, error out=w5)
  $"data in" <- w4
  call "ReadQueue.gvi"(N_elements=$N_qam, queue CDBL=w2, type="CDBL", timeout=-1, error in=$"error in") -> (out CDBL=w6, error out=w7)
  $"qam in" <- w6
  call "ReadQueue.gvi"(N_elements=$N_samples, queue CDBL=w3, type="CDBL", timeout=-1, error in=$"error in") -> (out CDBL=w8, error out=w9)
  $"samples in" <- w8
  Property Node(instance in=$rx) -> ("data"=w10, "qam debug"=w11, "CE debug"=w12, "pre debug"=w13)
  call "ReadQueue.gvi"(queue uint8=w10, N_elements=$N_data, type="uint8", timeout=-1, error in=$"error in") -> (out uint8=w14, error out=w15)
  call "ReadQueue.gvi"(N_elements=$N_qam, queue CDBL=w11, type="CDBL", timeout=-1, error in=$"error in") -> (out CDBL=w16, error out=w17)
  call "ReadQueue.gvi"(N_elements=$N_preamble, queue CDBL=w13, type="CDBL", timeout=-1, error in=$"error in") -> (out CDBL=w18, error out=w19)
  call "ReadQueue.gvi"(N_elements=$N_CE, queue CDBL=w12, type="CDBL", timeout=-1, error in=$"error in") -> (out CDBL=w20, error out=w21)
  Merge Errors(w5, w7, w9, w17, w15, w21, w19) -> (error out=w22)
  $"error out" <- w22
  $"data out" <- w14
  $"qam out" <- w16
  $"ce out" <- w20
  $"pre out" <- w18
