vi "Rx.gvi"   [LabVIEW Communications System Design Suite 2.0.1]
inputs:
  "sync_in queue": Queue<c128>
  "eq_out queue": Queue<c128>
  "pre_in queue": Queue<c128>
  "ce_out queue": Queue<c128>
  "qam_out queue": Queue<c128>
  "data_out queue": Queue<u8>
  "GFDM_params": "GFDM_params.gtype"
  "Preamble_params": "Preamble_params.gtype"
  "Frame_in": "Frame_in.gtype"
  "Frame_out": "Frame_out.gtype"
  "stop ce": DataValueReference<bool>
  "stop eq": DataValueReference<bool>
  "stop demod": DataValueReference<bool>
  "stop decoder": DataValueReference<bool>
  "dec frame count": DataValueReference<i32>
  "error in": error
  "ce debug queue": Queue<c128>
  "qam out debug queue": Queue<c128>
  "enable debug": bool
  "pre debug": Queue<c128>
  "total frames": i32
  "Pass decoder": bool
outputs:
  "Error out": error
types:
  "GFDM_params.gtype" = cluster{"K_set": i32[], "M_set": i32[], "N_on": i32, "K": i32, "M": i32, "N": i32, "N_cp": i32, "N_cs": i32, "Wt": c128[][], "Wrf": c128[][], "w_cs": c128[], "N_s": i32}
  "Frame_in.gtype" = cluster{"payload": i32, "N_on": i32, "rate": enum{"1/2", "1/3", "1/4", "2/3", "3/4", "1"}, "MC": enum{"4", "16", "64", "256"}}
  "Frame_out.gtype" = cluster{"NB": i32, "Nb_padd": i32, "Nenc_padd": i32, "Ns_padd": i32, "Ns": i32, "m": u8, "Nenc": i32, "Nbit": i32}
  "Preamble_params.gtype" = cluster{"Ncp": i32, "Ncs": i32, "K": i32, "M": i32, "pre64": c128[], "pref64": c128[], "pre_cp": c128[], "N": i32}
diagram:
  while (iteration -> i1) {
    Is Greater Or Equal(x=i1, y=$"total frames") -> w1
    in-place {
      Read Poser(ro0=$"stop ce")
      Write Poser(wi0=w1) -> (wo0=w2)
    }
    in-place {
      Read Poser(ro0=w2) -> (ri0=w3, ri1=w4)
      Write Poser(wi0=w3)
    }
    Select(s=w3, t=0, f=-1) -> w5
    Merge Errors(w4, $"error in") -> (error out=w6)
    call "CE_estimation.gvi"(GFDM_params=$GFDM_params, pre_in queue=$"pre_in queue", ce_out queue=$"ce_out queue", error in=w6, timeout=w5, Preamble_params=$Preamble_params) -> (hf=w7, Error=w8, pre_e=w9)
    case ($"enable debug") {
      frame False, Default {
        w10 = w8
      }
      frame True {
        for {
          w11 = each element of w9
          Enqueue Element(element=w11, error in=w8, queue=$"pre debug") -> (error out=w10)
        }
      }
    }
    case ($"enable debug") {
      frame False, Default {
        w12 = w8
      }
      frame True {
        for {
          w13 = each element of w7
          Enqueue Element(element=w13, error in=w8, queue=$"ce debug queue") -> (error out=w12)
        }
      }
    }
    Merge Errors(w10, w12) -> (error out=w14)
    stop if w3
  }
  Property Node(instance in=$Frame_out) -> ("NB"=w15)
  Property Node(instance in=$Frame_out) -> ("NB"=w16)
  Multiply(w16, $"total frames") -> w17
  while (iteration -> i2) {
    Property Node(instance in=$GFDM_params) -> ("N"=w18)
    Is Greater Or Equal(x=i2, y=w17) -> w19
    in-place {
      Read Poser(ro0=$"stop eq") -> (ri1=w20)
      Write Poser(wi0=w19) -> (wo0=w21)
    }
    in-place {
      Read Poser(ro0=w21) -> (ri0=w22, ri1=w23)
      Write Poser(wi0=w22)
    }
    Merge Errors($"error in", w23) -> (error out=w24)
    Quotient And Remainder(x=i2, y=w15) -> (x-y*floor(x/y)=w25)
    Is Equal(x=0, y=w25) -> w26
    Logical And(w26, not w22) -> w27
    Feedback Node(input=w28) -> w29
    case (w27) {
      frame False, Default {
        w30 = w24
        w28 = w29
      }
      frame True {
        for (N = w18) {
          Dequeue Element(error in=w24, queue=$"ce_out queue", timeout in ms=-1) -> (element=w31, error out=w30)
          append w31 to w28
        }
      }
    }
    Select(s=w22, t=0, f=-1) -> w32
    call "Equalizer.gvi"(GFDM_params=$GFDM_params, sync_in queue=$"sync_in queue", eq_out queue=$"eq_out queue", error in=w30, timeout=w32, h_eq=w28) -> (Error=w33)
    stop if w22
  }
  while (iteration -> i3) {
    Is Greater Or Equal(x=i3, y=w17) -> w34
    in-place {
      Read Poser(ro0=$"stop demod") -> (ri1=w35)
      Write Poser(wi0=w34) -> (wo0=w36)
    }
    in-place {
      Read Poser(ro0=w36) -> (ri0=w37, ri1=w38)
      Write Poser(wi0=w37)
    }
    Select(s=w37, t=0, f=-1) -> w39
    Merge Errors($"error in", w38) -> (error out=w40)
    call "DemodGFDMblock.gvi"(GFDM_params=$GFDM_params, eq_in queue=$"eq_out queue", qam_out queue=$"qam_out queue", error in=w40, timeout=w39) -> (Error=w41, d=w42)
    case ($"enable debug") {
      frame False, Default {
        w43 = w41
      }
      frame True {
        for {
          w44 = each element of w42
          Enqueue Element(element=w44, error in=w41, queue=$"qam out debug queue") -> (error out=w43)
        }
      }
    }
    stop if w37
  }
  while (iteration -> i4) {
    in-place {
      Read Poser(ro0=$"dec frame count") -> (ri1=w45)
      Write Poser(wi0=i4)
    }
    Is Greater Or Equal(x=i4, y=$"total frames") -> w46
    in-place {
      Read Poser(ro0=$"stop decoder") -> (ri1=w47)
      Write Poser(wi0=w46) -> (wo0=w48)
    }
    in-place {
      Read Poser(ro0=w48) -> (ri0=w49, ri1=w50)
      Write Poser(wi0=w49)
    }
    Merge Errors($"error in", w45, w50) -> (error out=w51)
    Select(s=w49, t=0, f=-1) -> w52
    call "DecodeFrame.gvi"(qam_in queue=$"qam_out queue", Frame_in=$Frame_in, Frame_out=$Frame_out, error in=w51, timeout=w52, data_out queue=$"data_out queue", Pass decoder=$"Pass decoder") -> (error out=w53)
    stop if w49
  }
  Merge Errors(w14, w33, w43, w53) -> (error out=w54)
  $"Error out" <- w54
