vi "Sync.gvi"   [LabVIEW Communications System Design Suite 2.0.1]
inputs:
  "sample_in queue": Queue<c128>
  "pre_out queue": Queue<c128>
  "sync_out queue": Queue<c128>
  "GFDM_params": "GFDM_params.gtype"
  "Preamble_params": "Preamble_params.gtype"
  "Frame_out": "Frame_out.gtype"
  "timeout": i32 = -1
  "error in": error
  "stop sync": DataValueReference<bool>
  "total frames": i32
outputs:
  "error out": error
types:
  "GFDM_params.gtype" = cluster{"K_set": i32[], "M_set": i32[], "N_on": i32, "K": i32, "M": i32, "N": i32, "N_cp": i32, "N_cs": i32, "Wt": c128[][], "Wrf": c128[][], "w_cs": c128[], "N_s": i32}
  "Preamble_params.gtype" = cluster{"Ncp": i32, "Ncs": i32, "K": i32, "M": i32, "pre64": c128[], "pref64": c128[], "pre_cp": c128[], "N": i32}
  "Frame_out.gtype" = cluster{"NB": i32, "Nb_padd": i32, "Nenc_padd": i32, "Ns_padd": i32, "Ns": i32, "m": u8, "Nenc": i32, "Nbit": i32}
diagram:
  Property Node(instance in=$Preamble_params) -> ("N"=w1, "Ncs"=w2, "Ncp"=w3)
  Add(w2, w3) -> w4
  Add(w1, w4) -> w5
  Property Node(instance in=$Preamble_params) -> ("N"=w6, "Ncp"=w7)
  Property Node(instance in=$GFDM_params) -> ("N_s"=w8)
  Property Node(instance in=$Frame_out) -> ("NB"=w9)
  Multiply(w8, w9) -> w10
  while (iteration -> i1) {
    for (N = w5) {
      in-place {
        Read Poser(ro0=$"stop sync") -> (ri0=w12, ri1=w13)
        Write Poser(wi0=w12)
      }
      Not(x=w12) -> w14
      case (w14) {
        frame False, Default {
          w15 = $"sample_in queue"
          w16 = default
          w17 = $"error in"
        }
        frame True {
          Dequeue Element(error in=$"error in", queue=$"sample_in queue", timeout in ms=$timeout) -> (element=w16, error out=w17, queue out=w15)
        }
      }
      append w16 to w11
    }
    Is Greater Or Equal(x=i1, y=$"total frames") -> w18
    in-place {
      Read Poser(ro0=$"stop sync") -> (ri1=w19)
      Write Poser(wi0=w18) -> (wo0=w20)
    }
    in-place {
      Read Poser(ro0=w20) -> (ri0=w21, ri1=w22)
      Write Poser(wi0=w21) -> (wo0=w23)
    }
    for (N = w10) {
      in-place {
        Read Poser(ro0=w23) -> (ri0=w24, ri1=w25)
        Write Poser(wi0=w24)
      }
      Not(x=w24) -> w26
      case (w26) {
        frame False, Default {
          Enqueue Element(element=0+0i, error in=w17, queue=$"sync_out queue") -> (error out=w27)
        }
        frame True {
          Dequeue Element(error in=w17, queue=w15, timeout in ms=$timeout) -> (element=w28, error out=w29)
          Enqueue Element(element=w28, error in=w29, queue=$"sync_out queue", timeout in ms=$timeout) -> (error out=w27)
        }
      }
    }
    call "RemoveCpCs.gvi"(error in=w17, x_cp=w11, N=w6, n0=w7) -> (x=w30, error out=w31)
    for {
      w32 = each element of w30
      Enqueue Element(element=w32, error in=w31, queue=$"pre_out queue", timeout in ms=$timeout) -> (error out=w33)
    }
    stop if w21
  }
  Merge Errors(w27, w33) -> (error out=w34)
  $"error out" <- w34
