vi "Test_Frame.gvi"   [LabVIEW Communications System Design Suite 2.0.1]
panel controls:
  "Frame_in": "Frame_in.gtype"
  "Max size": i32 = 10
  "Total frames": i32 = 10
panel indicators:
  "in frame count": i32
  "out frame count": i32
  "error out": error
  "Frame_out": "Frame_out.gtype"
  "created data?": bool
  "created qam?": bool
  "number elements in queue": i32
  "number pending remove": i32
  "Error 1": error
  "Error 2": error
  "Error 3": error
  "data byte": u8[]
  "out array": u8[]
  "in Array": u8[]
  "Error": error
  "timed out?": bool
  "appended array": u8[]
  "qam out": u8[]
  "number elements in queue_2": i32
  "enc_data": i8[]
  "qam_in": u8[]
  "en_out": i8[]
  "n_error": f64
  "double precision float": f64[]
  "double precision float_2": f64[]
types:
  "Frame_in.gtype" = cluster{"payload": i32, "N_on": i32, "rate": enum{"1/2", "1/3", "1/4", "2/3", "3/4", "1"}, "MC": enum{"4", "16", "64", "256"}}
  "Frame_out.gtype" = cluster{"NB": i32, "Nb_padd": i32, "Nenc_padd": i32, "Ns_padd": i32, "Ns": i32, "m": u8, "Nenc": i32, "Nbit": i32}
diagram:
  w1 = $"Max size"
  for (N = w1) {
    Random Number() -> (number (0 to 1)=w3)
    Multiply(w3, 255) -> w4
    To Unsigned Byte Integer(number=w4) -> w5
    append w5 to w2
  }
  $"in Array" <- w2
  Obtain Queue(create if not found?=TRUE, element data type=u8 0, error in=no error, name="Data byte in") -> (created new?=w6, error out=w7, queue out=w8)
  $"created data?" <- w6
  while (iteration -> i1) {
    w9 = each element of w2
    Increment(x=i1) -> w10
    Is Greater Or Equal(x=$"Max size", y=w10) -> w11
    case (w11) {
      frame False, Default {
        w12 = w7
        w13 = w8
      }
      frame True {
        Enqueue Element(element=w9, error in=w7, queue=w8, timeout in ms=-1) -> (error out=w12, queue out=w13)
      }
    }
    Get Queue Status(queue=w13) -> (# elements in queue=w14, # pending remove=w15, queue out=w16)
    $"number pending remove" <- w15
    $"number elements in queue" <- w14
    Not(x=w11) -> w17
    stop if w17
  }
  $"Error 1" <- w12
  Obtain Queue(create if not found?=TRUE, element data type=c128 0+0i, error in=no error, name="QAM symbol out") -> (created new?=w18, error out=w19, queue out=w20)
  $"created qam?" <- w18
  w21 = $Frame_in
  Property Node(instance in=w21) -> ("payload"=w22)
  Quotient And Remainder(x=$"Max size", y=w22) -> (floor(x/y)=w23)
  $"Total frames" <- w23
  call "FrameParams.gvi"(Frame_in=w21, error in=no error) -> (Frame_out=w24, error out=w25)
  Obtain Queue(create if not found?=TRUE, element data type=u8 0, error in=no error, name="Data byte out") -> (error out=w26, queue out=w27)
  Merge Errors(w26, w25, w19) -> (error out=w28)
  while (iteration -> i2) {
    call "DecodeFrame.gvi"(qam_in queue=w20, Frame_in=w21, Frame_out=w24, error in=w28, timeout=-1, data_out queue=w27) -> (qam_in queue out=w29, data_out queue out=w30, enc_data=w31, error out=w32, qam=w33)
    $"qam out" <- w33
    $en_out <- w31
    Increment(x=i2) -> w34
    Is Less Or Equal(x=$"Total frames", y=w34) -> w35
    $"out frame count" <- i2
    stop if w35
  }
  while (iteration -> i3) {
    call "PrepareFrame.gvi"(data_in queue=w8, Frame_in=w21, Frame_out=w24, error in=w7, timeout=-1, qam_out queue=w20) -> (data byte=w36, enc_data=w37, qam_out queue out=w38, error out=w39, qam=w40)
    $"data byte" <- w36
    $enc_data <- w37
    $qam_in <- w40
    Get Queue Status(queue=w38) -> (# elements in queue=w41)
    $"number elements in queue_2" <- w41
    $"in frame count" <- i3
    Increment(x=i3) -> w42
    Is Less Or Equal(x=$"Total frames", y=w42) -> w43
    stop if w43
  }
  s1 = u8[] []  # shift register
  while (iteration -> i4) {
    Dequeue Element(error in=w28, queue=w27, timeout in ms=-1) -> (element=w44, error out=w45, timed out?=w46)
    Build Array[ConcatenateInputs=True](s1, w44) -> w47
    $"appended array" <- w47
    $"timed out?" <- w46
    Increment(x=i4) -> w48
    Is Less Or Equal(x=$"Max size", y=w48) -> w49
    next s1 = w47
    stop if w49
  }
  Merge Errors(w39, w12, w32, w45) -> (error out=w50)
  Release Queue(error in=w50, force destroy?=TRUE, queue=w29) -> (error out=w51)
  Release Queue(error in=w51, force destroy?=TRUE, queue=w30) -> (error out=w52)
  Release Queue(error in=w52, force destroy?=FALSE, queue=w16) -> (error out=w53)
  $"error out" <- w53
  $"Error 2" <- w39
  To Double Precision Float(number=w2) -> w54
  $"double precision float" <- w54
  $Frame_out <- w24
  To Double Precision Float(number=s1) -> w55
  call "MSE.gvi"(error in=w50, x=w54, xe=w55) -> (n_error=w56)
  $n_error <- w56
  $"Error 3" <- w32
  $"double precision float_2" <- w55
  $"out array" <- s1
  $Error <- w45
