vi "reftest.gvi"   [LabVIEW Communications System Design Suite 2.0.1]
panel controls:
  "data value": u8
  "stop1": bool
  "stop1_2": bool
panel indicators:
  "data value_2": u8
  "loop iteration": i32
diagram:
  New Data Value Reference(data value=$"data value", error in (no error)=no error) -> (data value reference=w1)
  while (iteration -> i1) {
    in-place {
      Read Poser(ro0=w1) -> (ri0=w2)
      Write Poser(wi0=w2)
    }
    $"data value_2" <- w2
    Wait(time to wait=1000)
    $"loop iteration" <- i1
    stop if $stop1
  }
  while (iteration -> i2) {
    in-place {
      Read Poser(ro0=w1)
      Write Poser(wi0=i2)
    }
    Wait(time to wait=10000)
    stop if $stop1_2
  }
