vi "test_TX.gvi"   [LabVIEW Communications System Design Suite 2.0.1]
panel controls:
  "Max size": i32 = 10
  "error in": error
  "Frame_in": "Frame_in.gtype"
  "stop read": bool
  "stop enc": bool
  "stop mod": bool
panel indicators:
  "number elements in queue": i32
  "number pending remove": i32
  "error out": error
  "timed out?": bool
  "Chart": f64
  "GFDM_params": "GFDM_params.gtype"
  "Frame_out": "Frame_out.gtype"
  "frame count": i32
  "frame": f64[]
  "frame_2": T1
types:
  "Frame_in.gtype" = cluster{"payload": i32, "N_on": i32, "rate": enum{"1/2", "1/3", "1/4", "2/3", "3/4", "1"}, "MC": enum{"4", "16", "64", "256"}}
  "GFDM_params.gtype" = cluster{"K_set": i32[], "M_set": i32[], "N_on": i32, "K": i32, "M": i32, "N": i32, "N_cp": i32, "N_cs": i32, "Wt": c128[][], "Wrf": c128[][], "w_cs": c128[], "N_s": i32}
  "Frame_out.gtype" = cluster{"NB": i32, "Nb_padd": i32, "Nenc_padd": i32, "Ns_padd": i32, "Ns": i32, "m": u8, "Nenc": i32, "Nbit": i32}
  T1 = cluster{"f0": f64, "df": f64, "magnitude": f64[]}
uses:
  NI::Analysis::Measurement::Power Spectral Density for 1 Chan (CDB).gvi
diagram:
  call "CreateQueues.gvi"(error in=$"error in") -> (error out=w1, TX.queue=w2, RX.queue=w3)
  call "GEN_GFDM_Params.gvi"(error in=w1) -> (GFDM_params=w4, error out=w5)
  call "CreateTxRefControl.gvi"(error in=w5) -> (error out=w6, REfControl=w7)
  Property Node(instance in=w7) -> ("stop enc"=w8, "stop mod"=w9, "frame count"=w10, instance out=w11)
  Property Node(instance in=w2) -> ("data"=w12, "samples"=w13, "qam"=w14)
  w15 = $"Max size"
  for (N = w15) {
    Random Number() -> (number (0 to 1)=w17)
    Multiply(w17, 255) -> w18
    To Unsigned Byte Integer(number=w18) -> w19
    append w19 to w16
  }
  while (iteration -> i1) {
    w20 = each element of w16
    Increment(x=i1) -> w21
    Is Greater Or Equal(x=$"Max size", y=w21) -> w22
    case (w22) {
      frame False, Default {
        w23 = w1
        w24 = w12
      }
      frame True {
        Enqueue Element(element=w20, error in=w1, queue=w12, timeout in ms=-1) -> (error out=w23, queue out=w24)
      }
    }
    Get Queue Status(queue=w24) -> (# elements in queue=w25, # pending remove=w26, queue out=w27)
    $"number pending remove" <- w26
    $"number elements in queue" <- w25
    Not(x=w22) -> w28
    stop if w28
  }
  call "GEN_Preamble.gvi"(Ncp_in=32, Ncs_in=32, error in=w1) -> (Preamble_params=w29)
  Property Node(instance in=w4) -> ("N_on"=w30)
  Property Node(instance in=$Frame_in, "N_on"=w30) -> (instance out=w31)
  call "FrameParams.gvi"(Frame_in=w31, error in=w1) -> (Frame_out=w32)
  call "Tx.gvi"(data_in queue=w12, Frame_in=$Frame_in, GFDM_params=w4, frame_out in=w32, Preamble_params=w29, error in=w5, qam_out queue=w14, sample_out queue=w13, stop enc=w8, stop mod=w9, gen frame count=w10, enable debug=FALSE) -> (Error=w33)
  Property Node(instance in=w29) -> ("pre_cp"=w34)
  Array Size(array=w34) -> (size(s)=w35)
  Property Node(instance in=w4) -> ("N_s"=w36)
  Property Node(instance in=w32) -> ("NB"=w37)
  Multiply(w37, w36) -> w38
  Add(w35, w38) -> w39
  while {
    for (N = w39) {
      Dequeue Element(error in=w5, queue=w13, timeout in ms=10) -> (element=w42, error out=w43, timed out?=w44)
      Absolute Value(x=w42) -> w45
      $Chart <- w45
      $"timed out?" <- w44
      append w42 to w40
      append w43 to w41
    }
    Absolute Value(x=w40) -> w46
    $frame <- w46
    call "Power Spectral Density for 1 Chan (CDB).gvi"(signal=w40, dB on=TRUE) -> (power spectral density=w47)
    $frame_2 <- w47
    w48 = $"stop enc"
    in-place {
      Read Poser(ro0=w8)
      Write Poser(wi0=w48)
    }
    w49 = $"stop mod"
    in-place {
      Read Poser(ro0=w9)
      Write Poser(wi0=w49)
    }
    in-place {
      Read Poser(ro0=w10) -> (ri0=w50)
      Write Poser(wi0=w50)
    }
    $"frame count" <- w50
    stop if $"stop read"
  }
  Merge Errors(w23, w33, w41, w6) -> (error out=w51)
  call "ReleaseQueues.gvi"(error in=w51, TX.queue=w2, RX.queue=w3) -> (error out=w52)
  call "ReleaseTxRefControl.gvi"(REfControl=w11, error in=w52) -> (error out=w53)
  $"error out" <- w53
  $Frame_out <- w32
  $GFDM_params <- w4
