vi "Tx.gvi"   [LabVIEW Communications System Design Suite 2.0.1]
inputs:
  "data_in queue": Queue<u8>
  "Frame_in": "Frame_in.gtype"
  "GFDM_params": "GFDM_params.gtype"
  "frame_out in": "Frame_out.gtype"
  "Preamble_params": "Preamble_params.gtype"
  "error in": error
  "qam_out queue": Queue<c128>
  "sample_out queue": Queue<c128>
  "stop enc": DataValueReference<bool>
  "stop mod": DataValueReference<bool>
  "gen frame count": DataValueReference<i32>
  "sample_out debug": Queue<c128>
  "qam_out debug": Queue<c128>
  "enable debug": bool
  "data debug": Queue<u8>
  "total frames": i32
outputs:
  "Error": error
types:
  "Frame_in.gtype" = cluster{"payload": i32, "N_on": i32, "rate": enum{"1/2", "1/3", "1/4", "2/3", "3/4", "1"}, "MC": enum{"4", "16", "64", "256"}}
  "GFDM_params.gtype" = cluster{"K_set": i32[], "M_set": i32[], "N_on": i32, "K": i32, "M": i32, "N": i32, "N_cp": i32, "N_cs": i32, "Wt": c128[][], "Wrf": c128[][], "w_cs": c128[], "N_s": i32}
  "Preamble_params.gtype" = cluster{"Ncp": i32, "Ncs": i32, "K": i32, "M": i32, "pre64": c128[], "pref64": c128[], "pre_cp": c128[], "N": i32}
  "Frame_out.gtype" = cluster{"NB": i32, "Nb_padd": i32, "Nenc_padd": i32, "Ns_padd": i32, "Ns": i32, "m": u8, "Nenc": i32, "Nbit": i32}
diagram:
  while (iteration -> i1) {
    Is Greater Or Equal(x=i1, y=$"total frames") -> w1
    in-place {
      Read Poser(ro0=$"stop enc") -> (ri1=w2)
      Write Poser(wi0=w1) -> (wo0=w3)
    }
    in-place {
      Read Poser(ro0=w3) -> (ri0=w4, ri1=w5)
      Write Poser(wi0=w4)
    }
    Select(s=w4, t=0, f=-1) -> w6
    call "PrepareFrame.gvi"(data_in queue=$"data_in queue", Frame_in=$Frame_in, Frame_out=$"frame_out in", error in=$"error in", timeout=w6, qam_out queue=$"qam_out queue") -> (data byte=w7, error out=w8)
    case ($"enable debug") {
      frame False, Default {
        w9 = w8
      }
      frame True {
        for {
          w10 = each element of w7
          Enqueue Element(element=w10, error in=w8, queue=$"data debug", timeout in ms=-1) -> (error out=w9)
        }
      }
    }
    Merge Errors(w9, w5) -> (error out=w11)
    stop if w4
  }
  Property Node(instance in=$"frame_out in") -> ("NB"=w12)
  Property Node(instance in=$Preamble_params) -> ("pre_cp"=w13)
  while (iteration -> i2) {
    Is Greater Or Equal(x=i2, y=$"total frames") -> w14
    in-place {
      Read Poser(ro0=$"stop mod") -> (ri1=w15)
      Write Poser(wi0=w14) -> (wo0=w16)
    }
    in-place {
      Read Poser(ro0=w16) -> (ri0=w17, ri1=w18)
      Write Poser(wi0=w17)
    }
    Merge Errors(w18, $"error in") -> (error out=w19)
    for {
      w20 = each element of w13
      case ($"enable debug") {
        frame False, Default {
          w21 = w19
          w22 = $"sample_out debug"
        }
        frame True {
          Enqueue Element(element=w20, error in=w19, queue=$"sample_out debug") -> (error out=w21, queue out=w22)
        }
      }
      Enqueue Element(element=w20, error in=w19, queue=$"sample_out queue") -> (error out=w23, queue out=w24)
      Merge Errors(w23, w21) -> (error out=w25)
    }
    Select(s=w14, t=0, f=-1) -> w26
    for (N = w12) {
      call "ModGFDMblock.gvi"(GFDM_params=$GFDM_params, qam_in queue=$"qam_out queue", sample_out queue=w24, error in=w25, timeout=w26) -> (d=w27, Error=w28, x_cp=w29)
      case ($"enable debug") {
        frame False, Default {
          w30 = w28
        }
        frame True {
          for {
            w31 = each element of w29
            Enqueue Element(element=w31, error in=w28, queue=w22) -> (error out=w32)
          }
          for {
            w33 = each element of w27
            Enqueue Element(element=w33, error in=w28, queue=$"qam_out debug") -> (error out=w34)
          }
          Merge Errors(w32, w34) -> (error out=w30)
        }
      }
    }
    in-place {
      Read Poser(ro0=$"gen frame count") -> (ri1=w35)
      Write Poser(wi0=i2)
    }
    stop if w17
  }
  Merge Errors(w11, w30) -> (error out=w36)
  $Error <- w36
