vi "control.gvi"   [LabVIEW Communications System Design Suite 2.0.1]
inputs:
  "tx.control": "TXRefControl.gtype"
  "rx.control": "RXRefControl.gtype"
  "channel": c128[]
  "stop mod": bool
  "chanel ref": DataValueReference<c128[]>
  "stop chann": DataValueReference<bool>
  "stop demod": bool
  "error in": error
  "noise": DataValueReference<f64>
  "nise power": f64
outputs:
  "Rx frame count": i32
  "Tx frame count": i32
  "error out": error
types:
  "TXRefControl.gtype" = cluster{"stop enc": DataValueReference<bool>, "stop mod": DataValueReference<bool>, "frame count": DataValueReference<i32>}
  "RXRefControl.gtype" = cluster{"stop dec": DataValueReference<bool>, "stop demod": DataValueReference<bool>, "frame count": DataValueReference<i32>, "stop ce": DataValueReference<bool>, "stop eq": DataValueReference<bool>}
diagram:
  Property Node(instance in=$"tx.control") -> ("stop enc"=w1, "stop mod"=w2, "frame count"=w3)
  in-place {
    Read Poser(ro0=w1)
    Write Poser(wi0=$"stop mod")
  }
  in-place {
    Read Poser(ro0=w2)
    Write Poser(wi0=$"stop mod")
  }
  Property Node(instance in=$"rx.control") -> ("stop ce"=w4, "stop eq"=w5, "stop demod"=w6, "stop dec"=w7, "frame count"=w8)
  Feedback Node[DelayCount=4](input=$"stop demod") -> w9
  in-place {
    Read Poser(ro0=w4)
    Write Poser(wi0=w9)
  }
  Feedback Node[DelayCount=3](input=$"stop demod") -> w10
  in-place {
    Read Poser(ro0=w5)
    Write Poser(wi0=w10)
  }
  Feedback Node(input=$"stop demod") -> w11
  in-place {
    Read Poser(ro0=w6)
    Write Poser(wi0=w11)
  }
  in-place {
    Read Poser(ro0=w7)
    Write Poser(wi0=$"stop demod")
  }
  in-place {
    Read Poser(ro0=$"chanel ref")
    Write Poser(wi0=$channel)
  }
  in-place {
    Read Poser(ro0=w3) -> (ri0=w12)
    Write Poser(wi0=w12)
  }
  $"Tx frame count" <- w12
  in-place {
    Read Poser(ro0=w8) -> (ri0=w13)
    Write Poser(wi0=w13)
  }
  $"Rx frame count" <- w13
  in-place {
    Read Poser(ro0=$"stop chann")
    Write Poser(wi0=$"stop mod") -> (wo1=w14)
  }
  Divide(x=$"nise power", y=2) -> w15
  Square Root(x=w15) -> w16
  in-place {
    Read Poser(ro0=$noise)
    Write Poser(wi0=w16) -> (wo1=w17)
  }
  Merge Errors($"error in", w14, w17) -> (error out=w18)
  $"error out" <- w18
