vi "CE_estimation.gvi"   [LabVIEW Communications System Design Suite 2.0.1]
inputs:
  "GFDM_params": "GFDM_params.gtype"
  "pre_in queue": Queue<c128>
  "ce_out queue": Queue<c128>
  "error in": error
  "timeout": i32 = -1
  "Preamble_params": "Preamble_params.gtype"
outputs:
  "pre_out queue out": Queue<c128>
  "ce_out queue out": Queue<c128>
  "hf": c128[]
  "Error": error
  "h": c128[]
  "pre_e": c128[]
types:
  "GFDM_params.gtype" = cluster{"K_set": i32[], "M_set": i32[], "N_on": i32, "K": i32, "M": i32, "N": i32, "N_cp": i32, "N_cs": i32, "Wt": c128[][], "Wrf": c128[][], "w_cs": c128[], "N_s": i32}
  "Preamble_params.gtype" = cluster{"Ncp": i32, "Ncs": i32, "K": i32, "M": i32, "pre64": c128[], "pref64": c128[], "pre_cp": c128[], "N": i32}
diagram:
  Property Node(instance in=$Preamble_params) -> ("N"=w1)
  for (N = w1) {
    Dequeue Element(error in=$"error in", queue=$"pre_in queue", timeout in ms=$timeout) -> (element=w3, error out=w4, queue out=w5)
    append w3 to w2
  }
  $"pre_out queue out" <- w5
  $pre_e <- w2
  Property Node(instance in=$Preamble_params) -> ("pref64"=w6)
  Property Node(instance in=$GFDM_params) -> ("N"=w7)
  call "ChannelEstimation.gvi"(pre_e=w2, pref64=w6, N=w7, error in=w4) -> (error out=w8, h=w9, hf=w10)
  $h <- w9
  Reciprocal(x=w10) -> w11
  for {
    w12 = each element of w11
    Enqueue Element(element=w12, error in=w8, queue=$"ce_out queue") -> (error out=w13, queue out=w14)
  }
  $"ce_out queue out" <- w14
  $hf <- w10
  $Error <- w13
