vi "CreateQueues.gvi"   [LabVIEW Communications System Design Suite 2.0.1]
inputs:
  "error in": error
outputs:
  "error out": error
  "TX.queue": "TX.queue.gtype"
  "RX.queue": "RX.queue.gtype"
types:
  "TX.queue.gtype" = cluster{"data": Queue<u8>, "qam": Queue<c128>, "samples": Queue<c128>, "qam debug": Queue<c128>, "samples debug": Queue<c128>, "data debug": Queue<u8>}
  "RX.queue.gtype" = cluster{"data": Queue<u8>, "samples": Queue<c128>, "qam": Queue<c128>, "sync": Queue<c128>, "pre": Queue<c128>, "CE": Queue<c128>, "qam debug": Queue<c128>, "pre debug": Queue<c128>, "CE debug": Queue<c128>, "eq": Queue<c128>}
diagram:
  Obtain Queue(create if not found?=TRUE, element data type=u8 0, error in=$"error in", name="tx.data debug") -> (queue out=w1)
  Obtain Queue(create if not found?=TRUE, element data type=u8 0, error in=$"error in", name="tx.data ") -> (error out=w2, queue out=w3)
  Obtain Queue(create if not found?=TRUE, element data type=c128 0+0i, error in=$"error in", name="tx.qam") -> (error out=w4, queue out=w5)
  Obtain Queue(create if not found?=TRUE, element data type=c128 0+0i, error in=$"error in", name="tx.sample ") -> (error out=w6, queue out=w7)
  Obtain Queue(create if not found?=TRUE, element data type=c128 0+0i, error in=$"error in", name="tx.qam debug") -> (error out=w8, queue out=w9)
  Obtain Queue(create if not found?=TRUE, element data type=c128 0+0i, error in=$"error in", name="tx.samples debug") -> (error out=w10, queue out=w11)
  Property Node(instance in="TX.queue.gtype" {all zero or empty}, "data"=w3, "qam"=w5, "samples"=w7, "qam debug"=w9, "samples debug"=w11, "data debug"=w1) -> (instance out=w12)
  $"TX.queue" <- w12
  Merge Errors(w2, w4, w6, w8, w10) -> (error out=w13)
  Obtain Queue(create if not found?=TRUE, element data type=c128 0+0i, error in=$"error in", name="rx.eq") -> (error out=w14, queue out=w15)
  Obtain Queue(create if not found?=TRUE, element data type=c128 0+0i, error in=$"error in", name="rx.qam") -> (error out=w16, queue out=w17)
  Obtain Queue(create if not found?=TRUE, element data type=u8 0, error in=$"error in", name="rx.dat") -> (error out=w18, queue out=w19)
  Obtain Queue(create if not found?=TRUE, element data type=c128 0+0i, error in=$"error in", name="rx.sample") -> (error out=w20, queue out=w21)
  Obtain Queue(create if not found?=TRUE, element data type=c128 0+0i, error in=$"error in", name="rx.sync") -> (error out=w22, queue out=w23)
  Obtain Queue(create if not found?=TRUE, element data type=c128 0+0i, error in=$"error in", name="rx.pre") -> (error out=w24, queue out=w25)
  Obtain Queue(create if not found?=TRUE, element data type=c128 0+0i, error in=$"error in", name="rx.pre debug") -> (error out=w26, queue out=w27)
  Obtain Queue(create if not found?=TRUE, element data type=c128 0+0i, error in=$"error in", name="rx.ce") -> (error out=w28, queue out=w29)
  Obtain Queue(create if not found?=TRUE, element data type=c128 0+0i, error in=$"error in", name="rx.ce debug") -> (error out=w30, queue out=w31)
  Obtain Queue(create if not found?=TRUE, element data type=c128 0+0i, error in=$"error in", name="rx.qam debug") -> (error out=w32, queue out=w33)
  Merge Errors(w13, w18, w16, w20, w22, w24, w28, w26, w30, w32, w14) -> (error out=w34)
  $"error out" <- w34
  Property Node(instance in="RX.queue.gtype" {all zero or empty}, "eq"=w15, "data"=w19, "qam"=w17, "samples"=w21, "sync"=w23, "pre"=w25, "CE"=w29, "pre debug"=w27, "CE debug"=w31, "qam debug"=w33) -> (instance out=w35)
  $"RX.queue" <- w35
