vi "CreateRxRefControl.gvi"   [LabVIEW Communications System Design Suite 2.0.1]
inputs:
  "error in": error
outputs:
  "error out": error
  "rx.control": "RXRefControl.gtype"
types:
  "RXRefControl.gtype" = cluster{"stop dec": DataValueReference<bool>, "stop demod": DataValueReference<bool>, "frame count": DataValueReference<i32>, "stop ce": DataValueReference<bool>, "stop eq": DataValueReference<bool>}
diagram:
  New Data Value Reference(data value=FALSE, error in (no error)=$"error in") -> (data value reference=w1, error out=w2)
  New Data Value Reference(data value=FALSE, error in (no error)=$"error in") -> (data value reference=w3, error out=w4)
  New Data Value Reference(data value=FALSE, error in (no error)=$"error in") -> (data value reference=w5, error out=w6)
  New Data Value Reference(data value=FALSE, error in (no error)=$"error in") -> (data value reference=w7, error out=w8)
  New Data Value Reference(data value=0, error in (no error)=$"error in") -> (data value reference=w9, error out=w10)
  Property Node(instance in="RXRefControl.gtype" {all zero or empty}, "stop dec"=w1, "stop demod"=w3, "frame count"=w9, "stop ce"=w5, "stop eq"=w7) -> (instance out=w11)
  $"rx.control" <- w11
  Merge Errors(w2, w4, w10, w6, w8) -> (error out=w12)
  $"error out" <- w12
