vi "CreateTxRefControl.gvi"   [LabVIEW Communications System Design Suite 2.0.1]
inputs:
  "error in": error
outputs:
  "error out": error
  "tx.Control": "TXRefControl.gtype"
types:
  "TXRefControl.gtype" = cluster{"stop enc": DataValueReference<bool>, "stop mod": DataValueReference<bool>, "frame count": DataValueReference<i32>}
diagram:
  New Data Value Reference(data value=FALSE, error in (no error)=$"error in") -> (data value reference=w1, error out=w2)
  New Data Value Reference(data value=FALSE, error in (no error)=$"error in") -> (data value reference=w3, error out=w4)
  New Data Value Reference(data value=0, error in (no error)=$"error in") -> (data value reference=w5, error out=w6)
  Property Node(instance in="TXRefControl.gtype" {all zero or empty}, "stop enc"=w1, "stop mod"=w3, "frame count"=w5) -> (instance out=w7)
  $"tx.Control" <- w7
  Merge Errors(w2, w4, w6) -> (error out=w8)
  $"error out" <- w8
