vi "DecodeFrame.gvi"   [LabVIEW Communications System Design Suite 2.0.1]
inputs:
  "qam_in queue": Queue<c128>
  "Frame_in": "Frame_in.gtype"
  "Frame_out": "Frame_out.gtype"
  "error in": error
  "timeout": i32 = -1
  "data_out queue": Queue<u8>
  "Pass decoder": bool
outputs:
  "qam_in queue out": Queue<c128>
  "data_out queue out": Queue<u8>
  "enc_data": i8[]
  "error out": error
  "qam data": c128[]
  "qam": u8[]
types:
  "Frame_out.gtype" = cluster{"NB": i32, "Nb_padd": i32, "Nenc_padd": i32, "Ns_padd": i32, "Ns": i32, "m": u8, "Nenc": i32, "Nbit": i32}
  "Frame_in.gtype" = cluster{"payload": i32, "N_on": i32, "rate": enum{"1/2", "1/3", "1/4", "2/3", "3/4", "1"}, "MC": enum{"4", "16", "64", "256"}}
diagram:
  Property Node(instance in=$Frame_out) -> ("Ns_padd"=w1, "Ns"=w2)
  for (N = w2) {
    Dequeue Element(error in=$"error in", queue=$"qam_in queue", timeout in ms=$timeout) -> (element=w4, error out=w5, queue out=w6)
    append w4 to w3
  }
  Property Node(instance in=$Frame_in) -> ("MC"=w7, "rate"=w8)
  call "QAMdemapper.gvi"(d=w3, MC=w7, error in=w5) -> (datai=w9, error out=w10)
  for (N = w1) {
    Dequeue Element(error in=w10, queue=w6, timeout in ms=$timeout) -> (error out=w11, queue out=w12)
  }
  $"qam_in queue out" <- w12
  $"qam data" <- w3
  case (w8) {
    frame "1/2", Default {
      w13 = 15
      w14 = TRUE
    }
    frame "1/3" {
      w13 = 13
      w14 = TRUE
    }
    frame "1/4" {
      w13 = 13
      w14 = TRUE
    }
    frame "2/3" {
      w13 = 5
      w14 = TRUE
    }
    frame "3/4" {
      w13 = 3
      w14 = TRUE
    }
    frame "1" {
      w13 = 0
      w14 = FALSE
    }
  }
  Property Node(instance in=$Frame_out) -> ("m"=w15, "Nenc"=w16)
  call "Byte2bit.gvi"(byte_in=w9, error in=w10, L=w15) -> (error out=w17, bit_out=w18)
  Array Subset(array=w18, index0=0, length0=w16) -> w19
  Logical And(w14, not $"Pass decoder") -> w20
  case (w20) {
    frame False, Default {
      w21 = w17
      w22 = w19
    }
    frame True {
      call "CCdecoder.gvi"(data_enc=w19, rate=w8, constraint length=w13, error in=w17) -> (data=w22, error out=w21)
    }
  }
  Property Node(instance in=$Frame_out) -> ("Nbit"=w23)
  Array Subset(array=w22, index0=0, length0=w23) -> w24
  call "Bit2byte.gvi"(bit_in=w24, error in=w21, L=8) -> (byte_out=w25, error out=w26)
  for {
    w27 = each element of w25
    Enqueue Element(element=w27, error in=w26, queue=$"data_out queue") -> (error out=w28, queue out=w29)
  }
  Merge Errors(w11, w28) -> (error out=w30)
  $"error out" <- w30
  $qam <- w9
  $enc_data <- w18
  $"data_out queue out" <- w29
