vi "DemodGFDMblock.gvi"   [LabVIEW Communications System Design Suite 2.0.1]
inputs:
  "GFDM_params": "GFDM_params.gtype"
  "eq_in queue": Queue<c128>
  "qam_out queue": Queue<c128>
  "error in": error
  "timeout": i32 = -1
outputs:
  "eq_in queue out": Queue<c128>
  "qam_out queue out": Queue<c128>
  "xf": c128[]
  "Error": error
  "d": c128[]
types:
  "GFDM_params.gtype" = cluster{"K_set": i32[], "M_set": i32[], "N_on": i32, "K": i32, "M": i32, "N": i32, "N_cp": i32, "N_cs": i32, "Wt": c128[][], "Wrf": c128[][], "w_cs": c128[], "N_s": i32}
diagram:
  Property Node(instance in=$GFDM_params) -> ("N"=w1)
  for (N = w1) {
    Dequeue Element(error in=$"error in", queue=$"eq_in queue", timeout in ms=$timeout) -> (element=w3, error out=w4, queue out=w5)
    append w3 to w2
  }
  $"eq_in queue out" <- w5
  $xf <- w2
  Property Node(instance in=$GFDM_params) -> ("K"=w6, "M"=w7, "K_set"=w8, "M_set"=w9, "Wrf"=w10)
  call "Demodulator.gvi"(error in=w4, Wr=w10, xf=w2, K=w6, M=w7, K_set=w8, M_set=w9) -> (error out=w11, d=w12)
  for {
    w13 = each element of w12
    Enqueue Element(element=w13, error in=w11, queue=$"qam_out queue") -> (error out=w14, queue out=w15)
  }
  $"qam_out queue out" <- w15
  $d <- w12
  $Error <- w14
