vi "Equalizer.gvi"   [LabVIEW Communications System Design Suite 2.0.1]
inputs:
  "GFDM_params": "GFDM_params.gtype"
  "sync_in queue": Queue<c128>
  "eq_out queue": Queue<c128>
  "error in": error
  "timeout": i32 = -1
  "h_eq": c128[]
outputs:
  "sync_in queue out": Queue<c128>
  "eq_out queue out": Queue<c128>
  "x": c128[]
  "Error": error
  "xf": c128[]
types:
  "GFDM_params.gtype" = cluster{"K_set": i32[], "M_set": i32[], "N_on": i32, "K": i32, "M": i32, "N": i32, "N_cp": i32, "N_cs": i32, "Wt": c128[][], "Wrf": c128[][], "w_cs": c128[], "N_s": i32}
uses:
  NI::Analysis::Transforms::Complex FFT.gvi
diagram:
  Property Node(instance in=$GFDM_params) -> ("N_s"=w1)
  for (N = w1) {
    Dequeue Element(error in=$"error in", queue=$"sync_in queue", timeout in ms=$timeout) -> (element=w3, error out=w4, queue out=w5)
    append w3 to w2
  }
  $"sync_in queue out" <- w5
  $x <- w2
  Property Node(instance in=$GFDM_params) -> ("N"=w6, "N_cp"=w7)
  call "RemoveCpCs.gvi"(error in=w4, x_cp=w2, N=w6, n0=w7) -> (x=w8, error out=w9)
  call "Complex FFT.gvi"(x=w8, FFT size=w6, error in=w9) -> (FFT{x}=w10, error out=w11)
  Multiply(w10, $h_eq) -> w12
  for {
    w13 = each element of w12
    Enqueue Element(element=w13, error in=w11, queue=$"eq_out queue") -> (error out=w14, queue out=w15)
  }
  $"eq_out queue out" <- w15
  $xf <- w12
  $Error <- w14
