vi "FIRConv.gvi"   [LabVIEW Communications System Design Suite 2.0.1]
inputs:
  "x_in": c128
  "h": c128[]
outputs:
  "x out": c128
diagram:
  Array Index(array=$h) -> (out0[_]=w1, out1[_]=w2, out2[_]=w3, out3[_]=w4, out4[_]=w5, out5[_]=w6, out6[_]=w7, out7[_]=w8, out8[_]=w9, out9[_]=w10, out10[_]=w11, out11[_]=w12, out12[_]=w13, out13[_]=w14, out14[_]=w15, out15[_]=w16)
  Multiply($x_in, w1) -> w17
  Feedback Node(input=$x_in) -> w18
  Multiply(w18, w2) -> w19
  Feedback Node(input=w18) -> w20
  Multiply(w20, w3) -> w21
  Feedback Node(input=w20) -> w22
  Multiply(w22, w4) -> w23
  Feedback Node(input=w22) -> w24
  Multiply(w24, w5) -> w25
  Feedback Node(input=w24) -> w26
  Multiply(w26, w6) -> w27
  Feedback Node(input=w26) -> w28
  Multiply(w28, w7) -> w29
  Feedback Node(input=w28) -> w30
  Multiply(w30, w8) -> w31
  Feedback Node(input=w30) -> w32
  Multiply(w32, w9) -> w33
  Feedback Node(input=w32) -> w34
  Multiply(w34, w10) -> w35
  Feedback Node(input=w34) -> w36
  Multiply(w36, w11) -> w37
  Feedback Node(input=w36) -> w38
  Multiply(w38, w12) -> w39
  Feedback Node(input=w38) -> w40
  Multiply(w40, w13) -> w41
  Feedback Node(input=w40) -> w42
  Multiply(w42, w14) -> w43
  Feedback Node(input=w42) -> w44
  Multiply(w44, w15) -> w45
  Feedback Node(input=w44) -> w46
  Multiply(w46, w16) -> w47
  Add(w17, w19, w21, w23, w25, w27, w29, w31, w33, w35, w37, w39, w41, w43, w45, w47) -> w48
  $"x out" <- w48
