vi "GEN_GFDM_Params.gvi"   [LabVIEW Communications System Design Suite 2.0.1]
inputs:
  "error in": error
  "select": enum{"default", "full", "half"} = "default"
  "K": i32
  "M": i32
  "N_cp": i32
  "N_cs": i32
  "alpha": f64
  "firs sub off": bool
outputs:
  "GFDM_params": "GFDM_params.gtype"
  "error out": error
types:
  "GFDM_params.gtype" = cluster{"K_set": i32[], "M_set": i32[], "N_on": i32, "K": i32, "M": i32, "N": i32, "N_cp": i32, "N_cs": i32, "Wt": c128[][], "Wrf": c128[][], "w_cs": c128[], "N_s": i32}
diagram:
  Math Node("select"=$select, "K1"=$K, "M1"=$M, "N_cp1"=$N_cp, "N_cs1"=$N_cs, "alpha"=$alpha, "suboff"=$"firs sub off", Error In=$"error in") -> ("K_set"=w1, "M_set"=w2, "N_on"=w3, "Wt"=w4, "Wrf"=w5, "K"=w6, "M"=w7, "N"=w8, "N_cp"=w9, "N_cs"=w10, "w_cs"=w11, "N_s"=w12, Error Out=w13)
  ~~~
   Kd = double(K1);
   Md = double(M1);
   N_cpd = double(N_cp1);
   N_csd = double(N_cs1);
   [K,M, N, N_cp, N_cs, N_on, Wt, Wrf, w_cs, N_s, K_set, M_set] =  gen_gfdm(Kd,Md,N_cpd,N_csd,alpha,select, suboff)
  ~~~
  $"error out" <- w13
  Property Node(instance in="GFDM_params.gtype" {all zero or empty}, "K_set"=w1, "M_set"=w2, "N_on"=w3, "K"=w6, "M"=w7, "N"=w8, "N_cp"=w9, "N_cs"=w10, "Wt"=w4, "Wrf"=w5, "w_cs"=w11, "N_s"=w12) -> (instance out=w14)
  $GFDM_params <- w14
