vi "GEN_Preamble.gvi"   [LabVIEW Communications System Design Suite 2.0.1]
inputs:
  "Ncp_in": i32
  "Ncs_in": i32
  "error in": error
  "select": enum{"default", "full", "half"} = "default"
outputs:
  "error out": error
  "Preamble_params": "Preamble_params.gtype"
types:
  "Preamble_params.gtype" = cluster{"Ncp": i32, "Ncs": i32, "K": i32, "M": i32, "pre64": c128[], "pref64": c128[], "pre_cp": c128[], "N": i32}
diagram:
  call "GenPreample.gvi"(Ncp=$Ncp_in, Ncs=$Ncs_in, Rational=25, Slop=8, error in=$"error in", select=$select) -> (pre_cp=w1, pref64=w2, error out=w3, pre64=w4)
  Multiply(64, 2) -> w5
  Property Node(instance in="Preamble_params.gtype" {all zero or empty}, "Ncp"=$Ncp_in, "Ncs"=$Ncs_in, "K"=64, "M"=2, "N"=w5, "pre_cp"=w1, "pref64"=w2, "pre64"=w4) -> (instance out=w6)
  $Preamble_params <- w6
  $"error out" <- w3
