vi "ModGFDMblock.gvi"   [LabVIEW Communications System Design Suite 2.0.1]
inputs:
  "GFDM_params": "GFDM_params.gtype"
  "qam_in queue": Queue<c128>
  "sample_out queue": Queue<c128>
  "error in": error
  "timeout": i32 = -1
outputs:
  "qam_in queue out": Queue<c128>
  "sample_out queue out": Queue<c128>
  "d": c128[]
  "Error": error
  "x_cp": c128[]
types:
  "GFDM_params.gtype" = cluster{"K_set": i32[], "M_set": i32[], "N_on": i32, "K": i32, "M": i32, "N": i32, "N_cp": i32, "N_cs": i32, "Wt": c128[][], "Wrf": c128[][], "w_cs": c128[], "N_s": i32}
diagram:
  Property Node(instance in=$GFDM_params) -> ("N_on"=w1)
  for (N = w1) {
    Dequeue Element(error in=$"error in", queue=$"qam_in queue", timeout in ms=$timeout) -> (element=w3, error out=w4, queue out=w5)
    append w3 to w2
  }
  $"qam_in queue out" <- w5
  $d <- w2
  Property Node(instance in=$GFDM_params) -> ("K"=w6, "M"=w7, "K_set"=w8, "M_set"=w9, "Wt"=w10)
  call "Modulator.gvi"(error in=w4, K=w6, M=w7, K_set=w8, M_set=w9, wt=w10, d=w2) -> (error out=w11, x=w12)
  Property Node(instance in=$GFDM_params) -> ("N"=w13, "N_cp"=w14, "N_cs"=w15, "w_cs"=w16)
  call "AddCpCsWindowing.gvi"(error in=w11, x=w12, Ncp=w14, Ncs=w15, w_cs=w16, N=w13) -> (x_cp=w17, error out=w18)
  for {
    w19 = each element of w17
    Enqueue Element(element=w19, error in=w18, queue=$"sample_out queue") -> (error out=w20, queue out=w21)
  }
  $"sample_out queue out" <- w21
  $x_cp <- w17
  $Error <- w20
