vi "PrepareFrame.gvi"   [LabVIEW Communications System Design Suite 2.0.1]
inputs:
  "data_in queue": Queue<u8>
  "Frame_in": "Frame_in.gtype"
  "Frame_out": "Frame_out.gtype"
  "error in": error
  "timeout": i32 = -1
  "qam_out queue": Queue<c128>
outputs:
  "data_in queue out": Queue<u8>
  "data byte": u8[]
  "enc_data": i8[]
  "qam_out queue out": Queue<c128>
  "error out": error
  "qam": u8[]
types:
  "Frame_out.gtype" = cluster{"NB": i32, "Nb_padd": i32, "Nenc_padd": i32, "Ns_padd": i32, "Ns": i32, "m": u8, "Nenc": i32, "Nbit": i32}
  "Frame_in.gtype" = cluster{"payload": i32, "N_on": i32, "rate": enum{"1/2", "1/3", "1/4", "2/3", "3/4", "1"}, "MC": enum{"4", "16", "64", "256"}}
diagram:
  Property Node(instance in=$Frame_in) -> ("payload"=w1)
  for (N = w1) {
    Dequeue Element(error in=$"error in", queue=$"data_in queue", timeout in ms=$timeout) -> (element=w3, error out=w4, queue out=w5)
    append w3 to w2
  }
  $"data_in queue out" <- w5
  $"data byte" <- w2
  Property Node(instance in=$Frame_in) -> ("rate"=w6)
  case (w6) {
    frame "1/2", Default {
      w7 = 15
      w8 = TRUE
    }
    frame "1/3" {
      w7 = 13
      w8 = TRUE
    }
    frame "1/4" {
      w7 = 13
      w8 = TRUE
    }
    frame "2/3" {
      w7 = 5
      w8 = TRUE
    }
    frame "3/4" {
      w7 = 3
      w8 = TRUE
    }
    frame "1" {
      w7 = 0
      w8 = FALSE
    }
  }
  call "Byte2bit.gvi"(byte_in=w2, error in=w4, L=8) -> (error out=w9, bit_out=w10)
  Property Node(instance in=$Frame_out) -> ("Nb_padd"=w11)
  Initialize Array(element=0, size=w11) -> w12
  Build Array[ConcatenateInputs=True](w10, w12) -> w13
  case (w8) {
    frame False, Default {
      # Bypass encoder
      Initialize Array(element=0, size=16) -> w16
      Build Array[ConcatenateInputs=True](w13, w16) -> w14
      w15 = w9
    }
    frame True {
      call "CCencoder.gvi"(data_in=w13, rate=w6, constraint length=w7, error in=w9) -> (enc_data=w14, error out=w15)
    }
  }
  Property Node(instance in=$Frame_out) -> ("Nenc_padd"=w17, "m"=w18, "Ns_padd"=w19)
  Initialize Array(element=0, size=w17) -> w20
  Build Array[ConcatenateInputs=True](w14, w20) -> w21
  call "Bit2byte.gvi"(bit_in=w21, error in=w15, L=w18) -> (byte_out=w22, error out=w23)
  Property Node(instance in=$Frame_in) -> ("MC"=w24)
  call "QAMmapper.gvi"(datai=w22, MC=w24, error in=w23) -> (d=w25, error out=w26)
  Initialize Array(element=0+0i, size=w19) -> w27
  Build Array[ConcatenateInputs=True](w25, w27) -> w28
  for {
    w29 = each element of w28
    Enqueue Element(element=w29, error in=w26, queue=$"qam_out queue") -> (error out=w30, queue out=w31)
  }
  $"qam_out queue out" <- w31
  $qam <- w22
  $enc_data <- w14
  $"error out" <- w30
