vi "ReadQueue.gvi"   [LabVIEW Communications System Design Suite 2.0.1]
inputs:
  "queue uint8": Queue<u8>
  "N_elements": i32
  "queue CDBL": Queue<c128>
  "type": "Type.gtype" = "uint8"
  "timeout": i32 = -1
  "error in": error
outputs:
  "out CDBL": c128[]
  "out uint8": u8[]
  "error out": error
types:
  "Type.gtype" = enum{"uint8", "uint16", "uint32", "int8", "int16", "int32", "bool", "DBL", "CDBL"}
diagram:
  case ($type) {
    frame "uint8", Default {
      for (N = $N_elements) {
        Dequeue Element(error in=$"error in", queue=$"queue uint8", timeout in ms=$timeout) -> (element=w4, error out=w2)
        append w4 to w3
      }
      w1 = default
    }
    frame "CDBL" {
      for (N = $N_elements) {
        Dequeue Element(error in=$"error in", queue=$"queue CDBL", timeout in ms=$timeout) -> (element=w5, error out=w2)
        append w5 to w1
      }
      w3 = default
    }
  }
  $"out uint8" <- w3
  $"out CDBL" <- w1
  $"error out" <- w2
