vi "ReleaseQueues.gvi"   [LabVIEW Communications System Design Suite 2.0.1]
inputs:
  "error in": error
  "TX.queue": "TX.queue.gtype"
  "RX.queue": "RX.queue.gtype"
outputs:
  "error out": error
types:
  "TX.queue.gtype" = cluster{"data": Queue<u8>, "qam": Queue<c128>, "samples": Queue<c128>, "qam debug": Queue<c128>, "samples debug": Queue<c128>, "data debug": Queue<u8>}
  "RX.queue.gtype" = cluster{"data": Queue<u8>, "samples": Queue<c128>, "qam": Queue<c128>, "sync": Queue<c128>, "pre": Queue<c128>, "CE": Queue<c128>, "qam debug": Queue<c128>, "pre debug": Queue<c128>, "CE debug": Queue<c128>, "eq": Queue<c128>}
diagram:
  Property Node(instance in=$"TX.queue") -> ("data debug"=w1, "data"=w2, "qam"=w3, "samples"=w4, "qam debug"=w5, "samples debug"=w6)
  Release Queue(error in=$"error in", force destroy?=TRUE, queue=w1) -> (error out=w7)
  Release Queue(error in=$"error in", force destroy?=TRUE, queue=w2) -> (error out=w8)
  Release Queue(error in=$"error in", force destroy?=TRUE, queue=w3) -> (error out=w9)
  Release Queue(error in=$"error in", force destroy?=TRUE, queue=w4) -> (error out=w10)
  Release Queue(error in=$"error in", force destroy?=TRUE, queue=w5) -> (error out=w11)
  Release Queue(error in=$"error in", force destroy?=TRUE, queue=w6) -> (error out=w12)
  Property Node(instance in=$"RX.queue") -> ("data"=w13, "qam"=w14, "samples"=w15, "sync"=w16, "pre"=w17, "CE"=w18, "qam debug"=w19, "pre debug"=w20, "CE debug"=w21, "eq"=w22)
  Release Queue(error in=$"error in", queue=w13) -> (error out=w23)
  Release Queue(error in=$"error in", force destroy?=TRUE, queue=w14) -> (error out=w24)
  Release Queue(error in=$"error in", force destroy?=TRUE, queue=w15) -> (error out=w25)
  Release Queue(error in=$"error in", force destroy?=TRUE, queue=w16) -> (error out=w26)
  Release Queue(error in=$"error in", force destroy?=TRUE, queue=w17) -> (error out=w27)
  Release Queue(error in=$"error in", force destroy?=TRUE, queue=w18) -> (error out=w28)
  Release Queue(error in=$"error in", force destroy?=TRUE, queue=w19) -> (error out=w29)
  Release Queue(error in=$"error in", force destroy?=TRUE, queue=w20) -> (error out=w30)
  Release Queue(error in=$"error in", force destroy?=TRUE, queue=w21) -> (error out=w31)
  Release Queue(error in=$"error in", force destroy?=TRUE, queue=w22) -> (error out=w32)
  Merge Errors(w7, w8, w9, w10, w23, w11, w12, w24, w25, w26, w27, w28, w29, w30, w31, w32) -> (error out=w33)
  $"error out" <- w33
