vi "ReleaseRxRefControl.gvi"   [LabVIEW Communications System Design Suite 2.0.1]
inputs:
  "rxRefcontrol": "RXRefControl.gtype"
  "error in": error
outputs:
  "error out": error
types:
  "RXRefControl.gtype" = cluster{"stop dec": DataValueReference<bool>, "stop demod": DataValueReference<bool>, "frame count": DataValueReference<i32>, "stop ce": DataValueReference<bool>, "stop eq": DataValueReference<bool>}
diagram:
  Property Node(instance in=$rxRefcontrol) -> ("stop dec"=w1, "stop dec"=w2, "frame count"=w3, "stop ce"=w4, "stop eq"=w5)
  Delete Data Value Reference(data value reference=w1, error in (no error)=$"error in") -> (error out=w6)
  Delete Data Value Reference(data value reference=w2, error in (no error)=$"error in") -> (error out=w7)
  Delete Data Value Reference(data value reference=w3, error in (no error)=$"error in") -> (error out=w8)
  Delete Data Value Reference(data value reference=w4, error in (no error)=$"error in") -> (error out=w9)
  Delete Data Value Reference(data value reference=w5, error in (no error)=$"error in") -> (error out=w10)
  Merge Errors(w6, w7, w8, w9, w10) -> (error out=w11)
  $"error out" <- w11
