vi "ReleaseTxRefControl.gvi"   [LabVIEW Communications System Design Suite 2.0.1]
inputs:
  "REfControl": "REfControl.gtype"
  "error in": error
outputs:
  "error out": error
types:
  "REfControl.gtype" = cluster{"stop enc": DataValueReference<bool>, "stop mod": DataValueReference<bool>, "frame count": DataValueReference<i32>}
diagram:
  Property Node(instance in=$REfControl) -> ("stop enc"=w1, "stop mod"=w2, "frame count"=w3)
  Delete Data Value Reference(data value reference=w1, error in (no error)=$"error in") -> (error out=w4)
  Delete Data Value Reference(data value reference=w2, error in (no error)=$"error in") -> (error out=w5)
  Delete Data Value Reference(data value reference=w3, error in (no error)=$"error in") -> (error out=w6)
  Merge Errors(w4, w5, w6) -> (error out=w7)
  $"error out" <- w7
