vi "CCencoder.gvi"   [LabVIEW Communications System Design Suite 2.0.1]
inputs:
  "data_in": i8[]
  "rate": enum{"1/2", "1/3", "1/4", "2/3", "3/4"} = "1/2"
  "constraint length": i32 = 3
  "error in": error
outputs:
  "enc_data": i8[]
  "error out": error
diagram:
  Initialize Array(element=0, size=16) -> w1
  Build Array[ConcatenateInputs=True]($data_in, w1) -> w2
  call "MT Convolutional Encoder (Rate).gvi"(input bit stream=w2, rate=$rate, constraint length=$"constraint length", initial state=0, error in=$"error in", reset?=TRUE) -> (output bit stream=w3, error out=w4)
  $enc_data <- w3
  $"error out" <- w4
