vi "FrameParams.gvi"   [LabVIEW Communications System Design Suite 2.0.1]
inputs:
  "Frame_in": "Frame_in.gtype"
  "error in": error
outputs:
  "Frame_out": "Frame_out.gtype"
  "error out": error
types:
  "Frame_in.gtype" = cluster{"payload": i32, "N_on": i32, "rate": enum{"1/2", "1/3", "1/4", "2/3", "3/4", "1"}, "MC": enum{"4", "16", "64", "256"}}
  "Frame_out.gtype" = cluster{"NB": i32, "Nb_padd": i32, "Nenc_padd": i32, "Ns_padd": i32, "Ns": i32, "m": u8, "Nenc": i32, "Nbit": i32}
diagram:
  Property Node(instance in=$Frame_in) -> ("MC"=w1, "payload"=w2, "N_on"=w3, "rate"=w4)
  To Long Integer(number=w1) -> w5
  To Long Integer(number=w4) -> w6
  Math Node("Mc_i"=w5, "Cr_i"=w6, "payload"=w2, "N_on"=w3, Error In=$"error in") -> ("Nb_padd"=w7, "Nenc_padd"=w8, "Ns_padd"=w9, "Nb"=w10, "Ns"=w11, "m"=w12, "Nenc"=w13, "Nbit"=w14, Error Out=w15)
  ~~~
  CCTRAIL = 16;
  Cr = [1/2, 1/3, 1/4, 2/3, 3/4, 1];
  MC = [4, 16, 64, 256];
  m = log2(MC(Mc_i+1));

  Nb_in = payload * 8 + CCTRAIL;

  if(Cr_i == 4)
      temp = double(mod(Nb_in, 3));
      if temp>0
          Nb_padd = 3-temp;
      else
          Nb_padd = 0;
      end
  else
      Nb_padd = 0;
  end
  Nb_padd = int32(Nb_padd);
  Nenc = ((Nb_in+Nb_padd)/Cr(Cr_i+1));

  Nenc_padd = 0;
  temp = double(mod(Nenc, m));
  if temp >0
      Nenc_padd = m-temp;
  else
      Nenc_padd = 0;
  end
  Nenc_padd = int32(Nenc_padd);
  Ns = ((Nenc+Nenc_padd)/m);

  Ns_padd = 0;
  N_ond = double(N_on);
  temp =  double(mod(Ns, N_ond));
  if temp >0
      Ns_padd = int32(N_ond-temp);
  else
      Ns_padd = int32(0);
  end
  Nb = ((Ns+Ns_padd)/N_ond);
  m  = uint8(m);
  Nenc = int32(Nenc);
  Nbit = int32(payload * 8) ;
  ~~~
  $"error out" <- w15
  Property Node(instance in="Frame_out.gtype" {all zero or empty}, "Nb_padd"=w7, "Nenc_padd"=w8, "Ns_padd"=w9, "Ns"=w11, "NB"=w10, "m"=w12, "Nenc"=w13, "Nbit"=w14) -> (instance out=w16)
  $Frame_out <- w16
