vi "QAMdemapper.gvi"   [LabVIEW Communications System Design Suite 2.0.1]
inputs:
  "d": c128[]
  "MC": enum{"4", "16", "64", "256"} = "4"
  "error in": error
outputs:
  "datai": u8[]
  "error out": error
diagram:
  To Long Integer(number=$MC) -> w1
  Math Node("d"=$d, "M_i"=w1, Error In=$"error in") -> ("datai"=w2, Error Out=w3)
  ~~~
  MC = [4, 16, 64, 256];
  Md = double(MC(M_i+1));
  datai = qamdemod(d,Md);
  datai = uint8(datai);
  ~~~
  $"error out" <- w3
  $datai <- w2
