vi "QAMmapper.gvi"   [LabVIEW Communications System Design Suite 2.0.1]
inputs:
  "datai": u8[]
  "MC": enum{"4", "16", "64", "256"} = "4"
  "error in": error
outputs:
  "d": c128[]
  "error out": error
diagram:
  To Long Integer(number=$MC) -> w1
  Math Node("datai"=$datai, "M_i"=w1, Error In=$"error in") -> ("d"=w2, Error Out=w3)
  ~~~
  MC = [4, 16, 64, 256];
  Md = double(MC(M_i+1));
  d = qammod(datai,Md);
  ~~~
  $"error out" <- w3
  $d <- w2
