vi "Main.gvi"   [LabVIEW Communications System Design Suite 2.0.1]
panel controls:
  "Max payload size": i32 = 10
  "Frame_in": "Frame_in.gtype"
  "enable debug": bool
  "stop status": bool
  "channel": c128[]
  "stop mod": bool
  "stop demod": bool
  "noise power": f64
  "alpha": f64
  "N_cs": i32
  "N_cp": i32
  "M": i32
  "K": i32
  "select": enum{"default", "full", "half"} = "default"
  "firs sub off": bool
  "frames per psd": i32
  "Pass decoder": bool
panel indicators:
  "error out": error
  "Tx frame count": i32
  "Rx frame count": i32
  "psd": T1
  "EVM": f64
  "CE": f64[][]
  "Preamble": f64[][]
  "Constellation": c128[][]
  "data": u8[][]
  "GFDM_params": "GFDM_params.gtype"
  "Frame_out": "Frame_out.gtype"
  "Preamble_params": "Preamble_params.gtype"
  "totalframes": i32
  "processed Frames": i32
  "Per frame BER": f64
  "samples in": c128[]
  "data": u8[]
  "preamble used": c128[]
  "samples": f64[]
types:
  "Frame_in.gtype" = cluster{"payload": i32, "N_on": i32, "rate": enum{"1/2", "1/3", "1/4", "2/3", "3/4", "1"}, "MC": enum{"4", "16", "64", "256"}}
  T1 = cluster{"f0": f64, "df": f64, "magnitude": f64[]}
  "GFDM_params.gtype" = cluster{"K_set": i32[], "M_set": i32[], "N_on": i32, "K": i32, "M": i32, "N": i32, "N_cp": i32, "N_cs": i32, "Wt": c128[][], "Wrf": c128[][], "w_cs": c128[], "N_s": i32}
  "Frame_out.gtype" = cluster{"NB": i32, "Nb_padd": i32, "Nenc_padd": i32, "Ns_padd": i32, "Ns": i32, "m": u8, "Nenc": i32, "Nbit": i32}
  "Preamble_params.gtype" = cluster{"Ncp": i32, "Ncs": i32, "K": i32, "M": i32, "pre64": c128[], "pref64": c128[], "pre_cp": c128[], "N": i32}
uses:
  NI::Analysis::Transforms::Complex FFT.gvi
  NI::Analysis::Measurement::Power Spectral Density for 1 Chan (CDB).gvi
diagram:
  call "CreateQueues.gvi"(error in=no error) -> (error out=w1, TX.queue=w2, RX.queue=w3)
  Property Node(instance in=w2) -> ("data"=w4)
  call "GenRadomData.gvi"(data in=w4, Max size=$"Max payload size", error in=w1) -> (error out=w5, data=w6)
  $data <- w6
  Property Node(instance in=$Frame_in) -> ("payload"=w7)
  Quotient And Remainder(x=$"Max payload size", y=w7) -> (floor(x/y)=w8)
  $totalframes <- w8
  call "GEN_GFDM_Params.gvi"(error in=no error, select=$select, K=$K, M=$M, N_cp=$N_cp, N_cs=$N_cs, alpha=$alpha, firs sub off=$"firs sub off") -> (GFDM_params=w9, error out=w10)
  $GFDM_params <- w9
  New Data Value Reference(data value=FALSE, error in (no error)=no error) -> (data value reference=w11, error out=w12)
  call "CreateRxRefControl.gvi"(error in=no error) -> (error out=w13, rx.control=w14)
  New Data Value Reference(data value=c128[] [], error in (no error)=no error) -> (data value reference=w15, error out=w16)
  New Data Value Reference(data value=0, error in (no error)=no error) -> (data value reference=w17, error out=w18)
  call "CreateTxRefControl.gvi"(error in=no error) -> (error out=w19, tx.Control=w20)
  Property Node(instance in=w9) -> ("N_on"=w21)
  Property Node(instance in=$Frame_in, "N_on"=w21) -> (instance out=w22)
  Property Node(instance in=w22) -> ("payload"=w23, "N_on"=w24)
  call "FrameParams.gvi"(Frame_in=w22, error in=w10) -> (Frame_out=w25, error out=w26)
  Property Node(instance in=w25) -> ("NB"=w27)
  Multiply(w27, w24) -> w28
  call "GEN_Preamble.gvi"(Ncp_in=$N_cp, Ncs_in=$N_cs, error in=no error, select=$select) -> (error out=w29, Preamble_params=w30)
  Property Node(instance in=w30) -> ("pre_cp"=w31, "N"=w32, "pre64"=w33)
  Property Node(instance in=w9) -> ("N_s"=w34, "N"=w35)
  Array Size(array=w31) -> (size(s)=w36)
  Multiply(w34, w27) -> w37
  Add(w37, w36) -> w38
  Build Array[ConcatenateInputs=True](w33, w33) -> w39
  while (iteration -> i1) {
    Logical Or($"stop mod", $"stop status") -> w41
    Logical Or($"stop demod", $"stop status") -> w42
    call "control.gvi"(tx.control=w20, rx.control=w14, channel=$channel, stop mod=w41, chanel ref=w15, stop chann=w11, stop demod=w42, error in=no error, noise=w17, nise power=$"noise power") -> (Rx frame count=w43, Tx frame count=w44, error out=w45)
    Is Greater Or Equal(x=i1, y=w8) -> w46
    Logical Or(w42, w46) -> w47
    Not(x=w47) -> w48
    case (w48) {
      frame False, Default {
        w49 = w45
        w50 = c128[] []
      }
      frame True {
        call "ReadAll.gvi"(tx=w2, rx=w3, N_data=w23, N_qam=w28, N_samples=w38, N_CE=w35, N_preamble=w32, error in=w45) -> (data in=w51, qam out=w52, data out=w53, qam in=w54, samples in=w50, ce out=w55, pre out=w56, error out=w49)
        call "Byte2bit.gvi"(byte_in=w51, L=8) -> (bit_out=w57)
        call "Byte2bit.gvi"(byte_in=w53, L=8) -> (bit_out=w58)
        call "MSE.gvi"(x=w57, xe=w58) -> (n_error=w59)
        Array Size(array=w58) -> (size(s)=w60)
        Divide(x=w59, y=w60) -> w61
        $"Per frame BER" <- w61
        call "MSE.gvi"(x=w54, xe=w52) -> (mse=w62)
        $EVM <- w62
        Build Array(w51, w53) -> w63
        $data <- w63
        Build Array(w54, w52) -> w64
        Absolute Value(x=w64) -> w65
        Array Max And Min(array=w65) -> (max value=w66)
        Divide(x=w64, y=w66) -> w67
        $Constellation <- w67
        call "Complex FFT.gvi"(x=$channel, FFT size=w35) -> (FFT{x}=w68)
        Build Array(w68, w55) -> w69
        Absolute Value(x=w69) -> w70
        $CE <- w70
        Build Array(w39, w56) -> w71
        Absolute Value(x=w71) -> w72
        $Preamble <- w72
        Absolute Value(x=w50) -> w73
        $samples <- w73
        Quotient And Remainder(x=$"processed Frames", y=$"frames per psd") -> (x-y*floor(x/y)=w74)
        Is Not Equal To 0(x=w74) -> w75
        Not(x=w75) -> w76
        Feedback Node(initial value=c128[] [], input=w77) -> w78
        Select(s=w75, t=w78, f=c128[] []) -> w79
        Build Array[ConcatenateInputs=True](w79, w50) -> w77
        case (w76) {
          frame False, Default { }
          frame True {
            call "Power Spectral Density for 1 Chan (CDB).gvi"(signal=w77, dB on=TRUE) -> (power spectral density=w80)
            $psd <- w80
          }
        }
      }
    }
    $"Tx frame count" <- w44
    $"Rx frame count" <- w43
    $"processed Frames" <- i1
    Feedback Node[DelayCount=5](input=$"stop status") -> w81
    Logical Or(w81, w46) -> w82
    concatenate w50 onto w40
    stop if w82
  }
  Merge Errors(w16, w12, w18) -> (error out=w83)
  Property Node(instance in=w2) -> ("samples"=w84)
  Property Node(instance in=w3) -> ("samples"=w85)
  call "Channel.gvi"(sample_in queue=w84, sample_out queue=w85, channel coeff=w15, timeout=-1, error in=w83, stop ch=w11, Noise amp=w17) -> (error out=w86)
  Property Node(instance in=w3) -> ("pre"=w87, "sync"=w88)
  call "Sync.gvi"(sample_in queue=w85, pre_out queue=w87, sync_out queue=w88, GFDM_params=w9, Preamble_params=w30, Frame_out=w25, timeout=-1, error in=no error, stop sync=w11, total frames=w8) -> (error out=w89)
  Property Node(instance in=w14) -> ("stop ce"=w90, "stop eq"=w91, "stop demod"=w92, "stop dec"=w93, "frame count"=w94)
  Property Node(instance in=w3) -> ("eq"=w95, "CE"=w96, "qam"=w97, "data"=w98, "qam debug"=w99, "CE debug"=w100, "pre debug"=w101)
  call "Rx.gvi"(sync_in queue=w88, eq_out queue=w95, pre_in queue=w87, ce_out queue=w96, qam_out queue=w97, data_out queue=w98, GFDM_params=w9, Preamble_params=w30, Frame_in=w22, Frame_out=w25, stop ce=w90, stop eq=w91, stop demod=w92, stop decoder=w93, dec frame count=w94, error in=w13, ce debug queue=w100, qam out debug queue=w99, enable debug=$"enable debug", pre debug=w101, total frames=w8, Pass decoder=$"Pass decoder") -> (Error out=w102)
  Property Node(instance in=w2) -> ("data"=w103, "samples"=w104, "qam"=w105, "samples debug"=w106, "qam debug"=w107, "data debug"=w108)
  Merge Errors(w1, w26, w29, w19) -> (error out=w109)
  Property Node(instance in=w20) -> ("stop enc"=w110, "stop mod"=w111, "frame count"=w112)
  call "Tx.gvi"(data_in queue=w103, Frame_in=w22, GFDM_params=w9, frame_out in=w25, Preamble_params=w30, error in=w109, qam_out queue=w105, sample_out queue=w104, stop enc=w110, stop mod=w111, gen frame count=w112, sample_out debug=w106, qam_out debug=w107, enable debug=$"enable debug", data debug=w108, total frames=w8) -> (Error=w113)
  Merge Errors(w5, w113, w86, w89, w102, w49) -> (error out=w114)
  $"error out" <- w114
  $Frame_out <- w25
  $Preamble_params <- w30
  $"preamble used" <- w39
  $"samples in" <- w40
