vi "Check Stop.gvi"   [LabVIEW Communications System Design Suite 2.0.1]
inputs:
  "error in": error
outputs:
  "stop": bool
  "error out": error
diagram:
  Obtain Notifier(create if not found?=TRUE, element data type=string "", error in=$"error in", name="stop notifier") -> (error out=w1, notifier out=w2)
  Wait On Notification With Notifier History(error in (no error)=w1, ignore previous (F)=FALSE, notifier=w2, timeout in ms (-1)=10) -> (error out=w3, notification=w4, notifier out=w5)
  Release Notifier(error in (no error)=w3, notifier=w5) -> (error out=w6)
  $"error out" <- w6
  Is Equal(x=w4, y="done") -> w7
  Property Node(instance in=w6) -> ("status"=w8)
  Logical Or(w8, w7) -> w9
  $stop <- w9
