vi "Create Stop.gvi"   [LabVIEW Communications System Design Suite 2.0.1]
inputs:
  "stop": bool
  "error in": error
outputs:
  "Error": error
diagram:
  case ($stop) {
    frame False, Default {
      w1 = $"error in"
    }
    frame True {
      Obtain Notifier(create if not found?=TRUE, element data type=string "", error in=$"error in", name="stop notifier") -> (error out=w2, notifier out=w3)
      Send Notification(error in (no error)=w2, notification="done", notifier=w3) -> (error out=w4, notifier out=w5)
      Release Notifier(error in (no error)=w4, notifier=w5) -> (error out=w1)
    }
  }
  $Error <- w1
