vi "Stop On Error.gvi"   [LabVIEW Communications System Design Suite 2.0.1]
inputs:
  "error in": error
outputs:
  "error out": error
diagram:
  call "Is Error.gvi"(error in=$"error in") -> (is error?=w1)
  call "Create Stop.gvi"(stop=w1, error in=no error) -> (Error=w2)
  Merge Errors($"error in", w2) -> (error out=w3)
  $"error out" <- w3
