vi "TestConvolutionalCode.gvi"   [LabVIEW Communications System Design Suite 2.0.1]
panel controls:
  "rate": enum{"1/2", "1/3", "1/4", "2/3", "3/4"} = "1/2"
  "constraint length": i32 = 13
  "data_in": u8[] = [1, 0, 1, 0, 1, 0, 1, 1]
  "error in_2": error
panel indicators:
  "mse": f64
  "n_error": f64
  "data": u8[]
  "error out_2": error
  "enc_data": i8[]
  "error out": error
diagram:
  call "Byte2bit.gvi"(byte_in=$data_in, error in=no error, L=8) -> (error out=w1, bit_out=w2)
  call "CCencoder.gvi"(data_in=w2, rate=$rate, constraint length=$"constraint length", error in=w1) -> (enc_data=w3, error out=w4)
  call "CCdecoder.gvi"(data_enc=w3, rate=$rate, constraint length=$"constraint length", error in=w4) -> (data=w5, error out=w6)
  call "Bit2byte.gvi"(bit_in=w5, error in=w6, L=8) -> (byte_out=w7, error out=w8)
  call "MSE.gvi"(error in=$"error in_2", x=$data_in, xe=w7) -> (error out=w9, mse=w10, n_error=w11)
  $mse <- w10
  $n_error <- w11
  $"error out_2" <- w9
  $enc_data <- w3
  $data <- w7
  $"error out" <- w8
