vi "test_Byte2bit_bit2Byte.gvi"   [LabVIEW Communications System Design Suite 2.0.1]
panel controls:
  "L": u8 = 3
  "Max size": i32 = 10
panel indicators:
  "error out": error
  "byte_out": u8[]
  "mse": f64
  "n_error": f64
  "in Array": u32[]
  "bit_out": i8[]
diagram:
  w1 = $"Max size"
  w2 = $L
  for (N = w1) {
    Random Number() -> (number (0 to 1)=w4)
    Scale By Power Of 2(n=w2, x=1) -> w5
    Multiply(w4, w5) -> w6
    To Unsigned Byte Integer(number=w6) -> w7
    Decrement(x=w5) -> w8
    Max And Min(x=w7, y=w8) -> (min(x,y)=w9: u32)
    append w9 to w3
  }
  call "Byte2bit.gvi"(byte_in=w3, error in=no error, L=w2) -> (error out=w10, bit_out=w11)
  call "Bit2byte.gvi"(bit_in=w11, error in=w10, L=w2) -> (byte_out=w12, error out=w13)
  call "MSE.gvi"(x=w3, xe=w12) -> (mse=w14, n_error=w15)
  $mse <- w14
  $"in Array" <- w3
  $n_error <- w15
  $byte_out <- w12
  $"error out" <- w13
  $bit_out <- w11
