vi "test_ChannelEstimation.gvi"   [LabVIEW Communications System Design Suite 2.0.1]
panel controls:
  "N": i32 = 256
  "Ncp": i32 = 32
  "Ncs": i32 = 16
  "h_in": c128[] = [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]
panel indicators:
  "h": c128[]
  "hf": f64[]
  "error out": error
  "pre": c128[]
  "pref64": c128[]
  "mse": f64
uses:
  NI::Analysis::Operations::1D Convolution (CDB).gvi
diagram:
  call "GenPreample.gvi"(Ncp=$Ncp, Ncs=$Ncs, Rational=25, Slop=8, error in=no error) -> (pre=w1, pref64=w2, error out=w3)
  Add($Ncp, $Ncs) -> w4
  call "1D Convolution (CDB).gvi"(x=$h_in, y=w1, algorithm="direct", error in=no error) -> (x * y=w5, error out=w6)
  Add(128, w4) -> w7
  Array Subset(array=w5, index0=0, length0=w7) -> w8
  Merge Errors(w6, w3) -> (error out=w9)
  call "RemoveCpCs.gvi"(error in=w9, x_cp=w8, Ncpcs=w4, n0=$Ncp) -> (x=w10, error out=w11)
  call "ChannelEstimation.gvi"(pre_e=w10, pref64=w2, N=$N, error in=w11) -> (error out=w12, h=w13, hf=w14)
  call "MSE.gvi"(x=$h_in, xe=w13) -> (mse=w15)
  $mse <- w15
  $h <- w13
  Absolute Value(x=w14) -> w16
  $hf <- w16
  $"error out" <- w12
  $pre <- w1
  $pref64 <- w2
