vi "test_CpCsWindowing_removeCPCS.gvi"   [LabVIEW Communications System Design Suite 2.0.1]
panel controls:
  "x": c128[] = [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]
  "Ncp": i32 = 4
  "Ncs": i32 = 2
  "w_cs": c128[] = [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]
  "error in": error
panel indicators:
  "error out": error
  "x_cp": c128[]
  "x_2": c128[]
  "error out_2": error
  "mse": f64
  "n_error": f64
  "error out_3": error
diagram:
  Array Size(array=$x) -> (size(s)=w1)
  call "AddCpCsWindowing.gvi"(error in=$"error in", x=$x, Ncp=$Ncp, Ncs=$Ncs, w_cs=$w_cs, N=w1) -> (x_cp=w2, error out=w3)
  call "RemoveCpCs.gvi"(error in=w3, x_cp=w2, N=w1, n0=$Ncp) -> (x=w4, error out=w5)
  call "MSE.gvi"(error in=w3, x=$x, xe=w4) -> (error out=w6, mse=w7, n_error=w8)
  $mse <- w7
  $n_error <- w8
  $"error out_2" <- w6
  $x_cp <- w2
  $x_2 <- w4
  $"error out" <- w3
  $"error out_3" <- w5
