vi "test_Genpreamble.gvi"   [LabVIEW Communications System Design Suite 2.0.1]
panel controls:
  "Ncp": i32 = 32
  "Ncs": i32 = 16
  "Rational": i32 = 25
  "Slop": i32 = 8
panel indicators:
  "error out": error
  "pre": f64[]
  "pref64": f64[]
diagram:
  call "GenPreample.gvi"(Ncp=$Ncp, Ncs=$Ncs, Rational=$Rational, Slop=$Slop, error in=no error) -> (pre=w1, pref64=w2, error out=w3)
  Absolute Value(x=w1) -> w4
  $pre <- w4
  Absolute Value(x=w2) -> w5
  $pref64 <- w5
  $"error out" <- w3
