vi "test_Modulator_Demodulator.gvi"   [LabVIEW Communications System Design Suite 2.0.1]
panel controls:
  "K": i32 = 8
  "M": i32 = 4
  "K_set": i32[] = [1, 2, 3, 4, 5, 6, 7, 8]
  "M_set": i32[] = [1, 2, 3, 4]
  "d_in": c128[] = [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]
  "gf": c128[] = [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]
panel indicators:
  "x": c128[]
  "error mod": error
  "error demod": error
  "d_out": c128[]
  "Wt": c128[][]
  "Wr": c128[][]
  "error out": error
  "mse": f64
  "n_error": f64
uses:
  NI::Analysis::Transforms::Complex FFT.gvi
diagram:
  call "GenWindow.gvi"(error in=no error, K=$K, M=$M, gf=$gf) -> (error out=w1, Wt=w2, Wt_f=w3)
  Reciprocal(x=w3) -> w4
  call "Modulator.gvi"(error in=no error, K=$K, M=$M, K_set=$K_set, M_set=$M_set, w=w2, d=$d_in) -> (error out=w5, x=w6)
  Merge Errors(w1, w5) -> (error out=w7)
  call "Complex FFT.gvi"(x=w6, FFT size=32, error in=w7) -> (FFT{x}=w8, error out=w9)
  call "Demodulator.gvi"(error in=w9, Wr=w4, xf=w8, K=$K, M=$M, K_set=$K_set, M_set=$M_set) -> (error out=w10, d=w11)
  call "MSE.gvi"(error in=w10, x=$d_in, xe=w11) -> (error out=w12, mse=w13, n_error=w14)
  $mse <- w13
  $n_error <- w14
  $d_out <- w11
  $x <- w6
  $"error out" <- w12
  $"error mod" <- w5
  $"error demod" <- w10
  $Wt <- w2
  $Wr <- w3
