vi "test_QAMmapper_demapper.gvi"   [LabVIEW Communications System Design Suite 2.0.1]
panel controls:
  "datai": i32[]
  "MC": enum{"4", "16", "64", "256"} = "4"
panel indicators:
  "datai_2": u8[]
  "error out": error
  "mse": f64
  "n_error": f64
diagram:
  call "QAMmapper.gvi"(datai=$datai, MC=$MC, error in=no error) -> (d=w1, error out=w2)
  call "QAMdemapper.gvi"(d=w1, MC=$MC, error in=w2) -> (datai=w3, error out=w4)
  $datai_2 <- w3
  $"error out" <- w4
  call "MSE.gvi"(x=$datai, xe=w3) -> (mse=w5, n_error=w6)
  $mse <- w5
  $n_error <- w6
