vi "cnt.gvi"   [LabVIEW Communications System Design Suite 2.0.1]
inputs:
  "up": bool
outputs:
  "cnt": i32
diagram:
  Feedback Node(initial value=0, input=w1) -> w2
  Increment(x=w2) -> w3
  Select(s=$up, t=w3, f=w2) -> w1
  $cnt <- w1
