vi "processor.gvi"   [LabVIEW Communications System Design Suite 2.0.1]
inputs:
  "stop": DataValueReference<bool>
  "queue in": Queue<i32>
outputs:
  "queue out": Queue<i32>
panel indicators:
  "in": i32
  "out": i32
diagram:
  Obtain Queue(element data type=i32 0) -> (queue out=w1)
  $"queue out" <- w1
  while {
    Dequeue Element(queue=$"queue in") -> (element=w2, error out=w3)
    case (w3) {
      frame Error { }
      frame No Error {
        Increment(x=w2) -> w4
        Enqueue Element(element=w4, queue=w1)
        $in <- w2
        $out <- w4
      }
    }
    in-place {
      Read Poser(ro0=$stop) -> (ri0=w5)
      Write Poser(wi0=w5)
    }
    stop if w5
  }
