vi "source.gvi"   [LabVIEW Communications System Design Suite 2.0.1]
inputs:
  "stop": DataValueReference<bool>
outputs:
  "queue out": Queue<i32>
panel indicators:
  "out": u8
diagram:
  Obtain Queue(element data type=i32 0) -> (queue out=w1)
  $"queue out" <- w1
  while {
    Random Number() -> (number (0 to 1)=w2)
    Multiply(w2, 10) -> w3
    To Unsigned Byte Integer(number=w3) -> w4
    Enqueue Element(element=w4, queue=w1)
    $out <- w4
    in-place {
      Read Poser(ro0=$stop) -> (ri0=w5)
      Write Poser(wi0=w5)
    }
    stop if w5
  }
